# Grasshopper definition robot.ghx (Grasshopper 0.9.76)
# plug-ins: Python Interpreter

reload = Button()

# ---- group: ROS client
disconnect = Button()
connect = Button()
restart = Button()
ros = PythonScript(restart=restart)  # -> ros_client
# ---------- ros: Python ----------
import time
import logging
import scriptcontext as sc

from roslibpy import Ros
from System import TimeSpan
from System.Threading import ManualResetEventSlim

import sys


not_nicepath = "C:\Program Files (x86)\IronPython 2.7\Lib\site-packages"

if not_nicepath in sys.path:
    sys.path.remove(not_nicepath)

LOGGER = logging.getLogger('roslibpy')

key = 'rosclient_%s' % str(ghenv.Component.InstanceGuid)
previous_client = sc.sticky.get(key, None)
if previous_client:
    previous_client.terminate()

ros_client = Ros('127.0.0.1', 9090)
sc.sticky[key] = ros_client

waitLock = ManualResetEventSlim(False)

ros_client.on_ready(lambda: waitLock.Set())

if not waitLock.Wait(TimeSpan.FromSeconds(5)):
    raise Exception('Unable to connect to ROS')

LOGGER.info('ROS connection opened')
# ---------- end ros ----------
connect_2 = PythonScript(ros_client=ros, connect=connect, disconnect=disconnect)  # -> out, ros_client
# ---------- connect_2: Python ----------
import logging
from System import TimeSpan
from System.Threading import ManualResetEventSlim

LOGGER = logging.getLogger('roslibpy')

if connect:
    if not ros_client.is_connected:
        LOGGER.debug('Connecting...')
        waitLock = ManualResetEventSlim(False)
        ros_client.on_ready(lambda: waitLock.Set())
        ros_client.connect()

        if not waitLock.Wait(TimeSpan.FromSeconds(5)):
            raise Exception('Unable to connect to ROS')
        LOGGER.debug('Reconnected')

if disconnect:
    if ros_client.is_connected:
        ros_client.terminate()
        LOGGER.debug('Terminated')
# ---------- end connect_2 ----------

# ----
# Robot
panel = Panel("C:\Users\rustr\workspace\robot_description\")
list = ValueList({"ur5", "ur10", "abb_irb6640_185_280", "staubli_tx60l", "panda"}, selected="staubli_tx60l")
path = PythonScript(path=panel, robot_name=list)  # -> resource_path
# ---------- path: Python ----------
import os

resource_path = os.path.join(os.path.abspath(path), robot_name)

assert(os.path.isdir(resource_path))
# ---------- end path ----------
create = Button()
create_2 = PythonScript(resource_path=path, create=create)  # -> robot
# ---------- create_2: Python ----------
import os

from scriptcontext import sticky as st
import rhinoscriptsyntax as rs

from compas.robots import Robot as UrdfRobot
from compas_fab.robots import Robot


from compas_ghpython import mesh_draw
from compas_ghpython.geometry import xform_from_transformation

# store data in component
guid = str(ghenv.Component.InstanceGuid)
robot_key = "robot_" + guid

if robot_key not in st:
    st[robot_key] = None

class Mesh(object):

    def __init__(self, mesh):
        self.mesh = mesh_draw(mesh)

    def transform(self, transformation):
        T = xform_from_transformation(transformation)
        self.mesh.Transform(T)
    
    def draw(self):
        return self.mesh
    
    def set_color(self, color_rgba):
        
        from System.Array import CreateInstance
        from System.Drawing import Color

        r, g, b, a = color_rgba
        col = Color.FromArgb(int(a*255), int(r*255), int(g*255), int(b*255))

        count = self.mesh.Vertices.Count
        colors = CreateInstance(Color, count)
        for i in range(count):
            colors[i] = col
        self.mesh.VertexColors.SetColors(colors)

if create:
    print resource_path
    filename = os.path.join(resource_path, "robot_description.urdf")
    model = UrdfRobot.from_urdf_file(filename)

    st[robot_key] = Robot(model, resource_path, client=None)
    st[robot_key].create(Mesh)

robot = st[robot_key]
# ---------- end create_2 ----------
set = PythonScript(robot=create_2, client=connect_2.ros_client)
# ---------- set: Python ----------
if robot and client:
    robot.set_client(client)
# ---------- end set ----------
robot = Data(create_2)

py = PythonScript(reload=reload)
# ---------- py: Python ----------
from compas_rhino.utilities.misc import get_tolerance
from compas_rhino.utilities.misc import unload_modules

from compas_ghpython import unload_modules
unload_modules("compas")
unload_modules("compas_fab")
# ---------- end py ----------
pt = Point(Point(436.9687239, 97.46495866, 535.0395408))

# ---- group: inverse kinematics
pt_2 = Point(Point(413.1636518, 107.775854, 538.2624764))
xy = XYPlane(Origin=pt_2)
reqmsg = PythonScript(robot=robot, plane=xy)  # -> reqmsg
# ---------- reqmsg: Python ----------
import math

from compas_fab.robots.backends.ros import Header
from compas_fab.robots.backends.ros import Pose
from compas_fab.robots.backends.ros import PoseStamped
from compas_fab.robots.backends.ros import JointState
from compas_fab.robots.backends.ros import MultiDOFJointState
from compas_fab.robots.backends.ros import RobotState
from compas_fab.robots.backends.ros import PositionIKRequest
from compas_fab.robots.backends.ros import GetPositionIKRequest

if robot:
    
    base_link = robot.get_base_link_name()
    planning_group = robot.main_planning_group
    pose = Pose(plane.Origin, plane.XAxis, plane.YAxis)
    joint_names = robot.get_configurable_joint_names()
    configuration = robot.get_configuration()
    joint_positions = [math.radians(d) for d in configuration]
    header = Header(frame_id=base_link)
    pose_stamped = PoseStamped(header, pose)
    joint_state = JointState(name=joint_names, position=joint_positions, header=header)
    #multi_dof_joint_state = MultiDOFJointState(header=header, joint_names=joint_names)
    multi_dof_joint_state = MultiDOFJointState(header=Header(frame_id=''))
    start_state = RobotState(joint_state, multi_dof_joint_state)
    ik_request = PositionIKRequest(group_name=planning_group,
                                   robot_state=start_state,
                                   pose_stamped=pose_stamped,
                                   avoid_collisions=True)
    reqmsg = GetPositionIKRequest(ik_request)
    print(reqmsg)
# ---------- end reqmsg ----------
ik = PythonScript(robot=robot, reqmsg=reqmsg)  # -> robot, configuration
# ---------- ik: Python ----------
import scriptcontext as sc
import logging
import roslibpy

import scriptcontext as sc
from compas_ghpython.utilities import update_component

from compas_fab.robots.backends.ros import GetPositionIKResponse
from compas_fab.robots.backends.ros import MoveItErrorCodes

LOGGER = logging.getLogger('roslibpy')

guid = str(ghenv.Component.InstanceGuid)
response_key = "response_" + guid
if response_key not in sc.sticky:
    sc.sticky[response_key] = None

def receive_message(msg):
    response = GetPositionIKResponse.from_msg(msg)
    if response.error_code == MoveItErrorCodes.SUCCESS:
        configuration = response.solution.joint_state.position
        robot.update(configuration)
        sc.sticky[response_key] = configuration
        
if robot:
    if robot.client:
        if robot.client.is_connected:
            srv = roslibpy.Service(robot.client, '/compute_ik', 'GetPositionIK')
            request = roslibpy.ServiceRequest(reqmsg.msg)
            srv.call(request, receive_message, receive_message)
    else:
        LOGGER.debug('Not connected')
else:
    LOGGER.debug('No ROS client found')


configuration = sc.sticky[response_key]
# ---------- end ik ----------

# ---- group: forward kinematics
# Configuration
number_slider = Slider(0, range=-360..360)
forward_kinematics = PythonScript(
    robot=robot,
    s1=number_slider,
    s2=Slider(0, range=-360..360),
    s3=Slider(0, range=-360..360),
    s4=Slider(0, range=-360..360),
    s5=Slider(0, range=-360..360),
    s6=Slider(0, range=-360..360))  # -> robot
# ---------- forward_kinematics: Python ----------
import math

import scriptcontext as sc
from compas_ghpython.utilities import update_component

if robot:
    positions = [math.radians(s) for s in [s1, s2, s3, s4, s5, s6]]
    robot.update(positions)
# ---------- end forward_kinematics ----------

# ----
xy_2 = XYPlane(Origin=pt)
start_timer = Button()
stop_timer = Button()
python = GhPythonScript(start_timer=start_timer, stop_timer=stop_timer)  # -> out, a
# ---------- python: Python ----------
import scriptcontext as sc
from compas_ghpython.utilities import update_component

guid = str(ghenv.Component.InstanceGuid)
timer_running_key = "timer_running_" + guid


if stop_timer or timer_running_key not in sc.sticky:
    sc.sticky[timer_running_key] = False

if start_timer:
    sc.sticky[timer_running_key] = True

if sc.sticky[timer_running_key]:
    update_component(ghenv, 1000)

if 'message' in sc.sticky:
    print sc.sticky['message']
    print sc.sticky['message']
# ---------- end python ----------

# ----
# TODO
# 2. Set tool
# 3. Set the base
list_2 = ValueList({"no_tool": 0, "measurement_tool": 1, "gripper": 2}, selected="gripper")
tools = Tools(tool_id=list_2)
base = PythonScript()  # -> base_frame
# ---------- base: Python ----------
from compas_fab.geometry import Frame

"""
origin = [-478.32, -214.49, -194.35]
xaxis = [0.00832, 0.99996, -0.00275]
yaxis = [-0.99990, 0.00835, 0.01182]

"""
origin = [0, 0, 0]
xaxis = [1, 0, 0]
yaxis = [0, 1, 0]

base_frame = Frame(list(origin), list(xaxis), list(yaxis))
# ---------- end base ----------

panel_2 = Panel(python.out)
update = Button()

py_2 = PythonScript(update=update)  # -> configurations, error
# ---------- py_2: Python ----------
import os
import scriptcontext as sc
from compas_fab.robots.backends.ros import MoveItErrorCodes
from compas_fab.utilities import read_data_from_json


guid = str(ghenv.Component.InstanceGuid)
response_key = "response_" + guid
if response_key not in sc.sticky:
    sc.sticky[response_key] = None

tmpdir = os.path.join(os.path.expanduser('~'), "Desktop", "tmp")
out_file = os.path.join(tmpdir, "out.json")

if update:
    sc.sticky[response_key] = read_data_from_json(out_file)

configurations = []

response = sc.sticky[response_key]

if response:
    configurations = response["positions"]
    error = response["error"]

print len(configurations)
# ---------- end py_2 ----------
error = Panel(py_2.error)
animate = PythonScript(robot=forward_kinematics, configurations=py_2.configurations, value=Slider(1, range=0..1))  # -> out, robot; inputs configurations: list
# ---------- animate: Python ----------
from compas_fab.utilities import map_range

configurations = configurations[1:]
count = len(configurations)
print count
idx = int(map_range(value, 0, 1, 0, count - 1))
print idx
if robot:
   robot.update(configurations[idx])
# ---------- end animate ----------

# ----
# Visualisation
update_2 = Button()
visualize = PythonScript(robot=robot, update=flatten([update_2, ik.robot, forward_kinematics, animate.robot]))  # -> visual, collision, frames, frames_color, ee_frame, ee_color, base_frame, base_color; inputs update: list
# ---------- visualize: Python ----------
from System.Drawing import Color

from compas.geometry import Vector
from compas.geometry import Point
from compas_ghpython.utilities import xdraw_frame
from compas_ghpython.utilities import xdraw_pipes


frames = []

size = 100
radius = 1

red = Color.FromArgb(255, 0, 0)
green = Color.FromArgb(0, 255, 0)
blue = Color.FromArgb(0, 0, 255)

frame_colors = [red, green, blue]

def pipes_from_frame(frame, size, radius): 
    pipes = []
    for axis in [frame.xaxis, frame.yaxis, frame.zaxis]:
        pipe = {}
        pipe['points'] = [list(frame.point), list(Point(*frame.point) + Vector(*axis) * size)]
        pipe['radius'] = radius
        pipes.append(pipe)
    return pipes

if robot:
    visual = robot.draw_visual()
    collision = robot.draw_collision()
    try:
        frames = robot.get_frames()
        print len(frames)
        print frames
    except:
        pass
    axes = robot.get_axes() # what to do with them?
    ee_frame = robot.get_end_effector_frame()
    base_frame = robot.get_base_frame()
    
    print robot.semantics
    
    print robot.get_base_link().name
    print base_frame
    
    pipes = []
    frames_color = []
    for frame in frames:
        pipes += pipes_from_frame(frame, size, radius)
        frames_color += frame_colors
    frames = xdraw_pipes(pipes, cap=1)
        
    
    ee_pipes = pipes_from_frame(ee_frame, size, radius)
    ee_frame = xdraw_pipes(ee_pipes, cap=1)
    ee_color = frame_colors
    
    base_pipes = pipes_from_frame(base_frame, size, radius)
    base_frame = xdraw_pipes(base_pipes, cap=1)
    base_color = frame_colors
    
    configuration = robot.get_configuration()
    print configuration
# ---------- end visualize ----------
geo = Geometry(visualize.visual)
geo_2 = Geometry(visualize.collision)
preview = CustomPreview(Geometry=visualize.frames, Shader=visualize.frames_color)
preview_2 = CustomPreview(Geometry=visualize.base_frame, Shader=visualize.base_color)
preview_3 = CustomPreview(Geometry=visualize.ee_frame, Shader=visualize.ee_color)

animate_2 = PythonScript(robot=robot, configurations=py_2.configurations)  # -> robot; inputs configurations: list; disabled
# ---------- animate_2: Python ----------
import scriptcontext as sc
from compas_ghpython.utilities import update_component

guid = str(ghenv.Component.InstanceGuid)
timer_running_key = "timer_running_" + guid
counter_key = "counter_" + guid
has_been_stopped_key = "has_been_stopped_" + guid

if stop or timer_running_key not in sc.sticky:
    sc.sticky[timer_running_key] = False
    sc.sticky[counter_key] = 0
    sc.sticky[has_been_stopped_key] = True

if start:
    sc.sticky[timer_running_key] = True
    sc.sticky[has_been_stopped_key] = False

if sc.sticky[has_been_stopped_key] == False:
    if len(configurations) and robot:
        current_idx = sc.sticky[counter_key] % len(configurations)
        configuration = configurations[current_idx]
        robot.update(configuration)
        sc.sticky[counter_key] += 1
        if sc.sticky[timer_running_key]:
            update_component(ghenv, 100)
# ---------- end animate_2 ----------
compute_path = PythonScript(robot=robot)  # -> out, response
# ---------- compute_path: Python ----------
import scriptcontext as sc

import logging
import roslibpy

from compas_fab.robots.backends.ros import GetCartesianPathResponse
from compas_fab.robots.backends.ros import MoveItErrorCodes

guid = str(ghenv.Component.InstanceGuid)
response_key = "response_" + guid
if response_key not in sc.sticky:
    sc.sticky[response_key] = None

LOGGER = logging.getLogger('roslibpy')
data = dict(requesting_solution=False)

def receive_message(msg):
    response = GetCartesianPathResponse.from_msg(msg)
    sc.sticky[response_key] = response
    update_component(ghenv, 1)

true = True
if robot:
    if robot.client:
        if robot.client.is_connected and compute:
            srv = roslibpy.Service(robot.client, '/compute_cartesian_path', 'GetCartesianPath')
            
            #reqmsg = {'start_state': {'attached_collision_objects': [], 'joint_state': {'velocity': [], 'effort': [], 'name': ['joint_1', 'joint_2', 'joint_3', 'joint_4', 'joint_5', 'joint_6'], 'position': [-1.49, 0.089, -2.21, 1.61, 1.64, -4.16], 'header': {'seq': 0, 'frame_id': 'base_link', 'stamp': {'nsecs': 0.0, 'secs': 0.0}}}, 'multi_dof_joint_state': {'wrench': [], 'twist': [], 'transforms': [], 'header': {'seq': 0, 'frame_id': 'base_link', 'stamp': {'nsecs': 0.0, 'secs': 0.0}}, 'joint_names': ['joint_1', 'joint_2', 'joint_3', 'joint_4', 'joint_5', 'joint_6']}, 'is_diff': False}, 'group_name': 'tx60l_arm', 'waypoints': [{'position': {'z': 0.401, 'y': -0.289, 'x': 0.0810}, 'orientation': {'z': 0.0, 'y': 0.0, 'x': 0.707, 'w': 0.707}}, {'position': {'z': 0.184, 'y': -0.386, 'x': 0.104}, 'orientation': {'z': 0.0, 'y': 0.0, 'x': 0.0, 'w': 1.0}}], 'path_constraints': {'visibility_constraints': [], 'joint_constraints': [], 'name': '', 'position_constraints': [], 'orientation_constraints': []}, 'link_name': 'flange', 'jump_threshold': 0.0, 'max_step': 0.186, 'header': {'seq': 0, 'frame_id': 'base_link', 'stamp': {'nsecs': 0.0, 'secs': 0.0}}, 'avoid_collisions': true}
            
            request = roslibpy.ServiceRequest(reqmsg.msg)
            #request = roslibpy.ServiceRequest(reqmsg)
            srv.call(request, receive_message, receive_message)

    else:
        LOGGER.debug('Not connected')
else:
    LOGGER.debug('No ROS client found')

response = sc.sticky[response_key]
# ---------- end compute_path ----------
py_3 = PythonScript(path_response=compute_path.response)  # -> configurations, error
# ---------- py_3: Python ----------
from compas_fab.robots.backends.ros import MoveItErrorCodes

configurations = []

if path_response:
    if path_response.error_code == MoveItErrorCodes.SUCCESS:
        start_position = path_response.start_state.joint_state.position
        
        print ">>", path_response.solution.multi_dof_joint_trajectory
        positions = []
        for point in path_response.solution.joint_trajectory.points:
            positions.append(point.positions)
        positions = [start_position] + positions
        configurations = positions
    error = path_response.error_code.human_readable

print configurations
# ---------- end py_3 ----------

# ---- group: calculate path
pt_3 = Point(Point(-221.3640594, 516.93965, 401.6164558))
max_step_mm = Slider(10, range=1..500)
avoid_collisions = BooleanToggle(True)
compute = Button()

# ----
yz = YZPlane(Origin=pt_3)

# ---- group: calculate path (continued)
py_4 = PythonScript(start_plane=xy_2, end_plane=yz)  # -> waypoints
# ---------- py_4: Python ----------
from compas_fab.robots.backends.ros import Pose

def plane_to_pose(plane):
    return Pose(plane.Origin, plane.XAxis, plane.YAxis)

start_pose = plane_to_pose(start_plane)
end_pose = plane_to_pose(end_plane)
waypoints = [start_pose, end_pose]

print waypoints

for pose in waypoints:
    print pose.msg
# ---------- end py_4 ----------
reqmsg_2 = PythonScript(
    robot=robot,
    current_configuration=ik.configuration,
    waypoints=py_4,
    max_step=max_step_mm,
    avoid_collisions=avoid_collisions)  # -> reqmsg; inputs current_configuration: list, waypoints: list
# ---------- reqmsg_2: Python ----------
import math

from compas_fab.robots.backends.ros import Header
from compas_fab.robots.backends.ros import Pose
from compas_fab.robots.backends.ros import PoseStamped
from compas_fab.robots.backends.ros import JointState
from compas_fab.robots.backends.ros import MultiDOFJointState
from compas_fab.robots.backends.ros import RobotState
from compas_fab.robots.backends.ros import GetCartesianPathRequest


if robot:
    
    base_link = robot.get_base_link_name()
    print base_link
    ee_link = robot.get_end_effector_link_name()
    print ee_link
    main_planning_group = robot.main_planning_group
    joint_names = robot.get_configurable_joint_names()
    #configuration = robot.get_configuration()
    #joint_positions = [round(math.radians(d),2) for d in configuration]
    #joint_positions = [0,0,0,0,0,0]
    joint_positions = current_configuration
    header = Header(frame_id=base_link)
    joint_state = JointState(header=header, name=joint_names, position=joint_positions)
    #multi_dof_joint_state = MultiDOFJointState(header=header, joint_names=joint_names)
    multi_dof_joint_state = MultiDOFJointState(header=header)
    start_state = RobotState(joint_state=joint_state, multi_dof_joint_state=multi_dof_joint_state)
        
    reqmsg = GetCartesianPathRequest(header=header,
                                     start_state=start_state,
                                     group_name=main_planning_group,
                                     link_name=ee_link,
                                     waypoints=waypoints,
                                     max_step=max_step,
                                     avoid_collisions=avoid_collisions)
                                     
    print(reqmsg)
# ---------- end reqmsg_2 ----------
compute_path_2 = PythonScript(reqmsg=reqmsg_2, compute=compute)
# ---------- compute_path_2: Python ----------
import scriptcontext as sc
import os
import subprocess
from compas.utilities import XFunc
from compas_fab.utilities import write_data_to_pickle
from compas_fab.utilities import read_data_from_pickle
from compas_fab.utilities import read_data_from_json

tmpdir = os.path.join(os.path.expanduser('~'), "Desktop", "tmp")

in_file = os.path.join(tmpdir, "in.pickle")
out_file = os.path.join(tmpdir, "out.json")

python_file = os.path.join(os.path.expanduser('~'), "workspace", "projects", "xfuncs", "moveit_srv.py")

guid = str(ghenv.Component.InstanceGuid)
response_key = "response_" + guid
if response_key not in sc.sticky:
    sc.sticky[response_key] = None

if reqmsg and compute:
    write_data_to_pickle(reqmsg.msg, in_file)
    subprocess.Popen(['python', python_file], stdout=subprocess.PIPE)
    

response = [sc.sticky[response_key]]
# ---------- end compute_path_2 ----------

# ==== cluster Tools
tool_id = ClusterInput()

test_geometry = Geometry([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])
yaxis_line = Curve(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)
xaxis_line = Curve(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)
mesh = Mesh(test_geometry)
brep = Brep(test_geometry)
tool = Tool(meshes=mesh, breps=brep, xline=xaxis_line, yline=yaxis_line)

# ---- group: measurement tool
measurement_tool_geo = Geometry([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])
tool_2 = PythonScript(breps=measurement_tool_geo)  # -> tool; inputs breps: list
# ---------- tool_2: Python ----------
from compas_fab.fab.robots.ur.tools import MeasurementTool
from compas_fab.fab.grasshopper.helpers import draw_mesh

tool = MeasurementTool()
tool.load_model(xdraw_function=draw_mesh)
tool.breps = breps
# ---------- end tool_2 ----------

# ----
tool_id_2 = Integer(tool_id)
tool_3 = PythonScript()  # -> tool
# ---------- tool_3: Python ----------
from compas_fab.fab.geometry import Frame
from compas_fab.fab.robots import Tool

tcp_frame = Frame.worldXY()

tool = Tool(tcp_frame)
tool.model = []
tool.breps = []
# ---------- end tool_3 ----------
filter = StreamFilter(Gate=tool_id_2, Stream0=tool_3, Stream1=tool_2, Stream2=tool)
py = PythonScript(tool=filter)  # -> tcp_frame, model
# ---------- py: Python ----------
tcp_frame = tool.tcp_frame
model = tool.model
# ---------- end py ----------
tool_4 = Data(filter)
draw = PythonScript(frame=py.tcp_frame)  # -> G, C
# ---------- draw: Python ----------
import Rhino.Geometry as rg
from System.Drawing import Color

if not size:
    size = 100

if frame:
    
    plane = rg.Plane(rg.Point3d(*frame.point), rg.Vector3d(*frame.xaxis), rg.Vector3d(*frame.yaxis))

    G = []
    G.append(rg.Line(plane.Origin, size * plane.XAxis))
    G.append(rg.Line(plane.Origin, size * plane.YAxis))
    G.append(rg.Line(plane.Origin, size * plane.ZAxis))
    
    C = []
    C.append(Color.FromArgb(255, 0, 0))
    C.append(Color.FromArgb(0, 255, 0))
    C.append(Color.FromArgb(0, 0, 255))
# ---------- end draw ----------
tool_5 = ClusterOutput(tool_4)
preview = CustomPreview(Geometry=draw.G, Shader=draw.C)
preview_2 = CustomPreview(Geometry=py.model, Shader=ColourSwatch(SwatchColor=RGB(141, 170, 178)))

# ==== cluster Tool
breps = ClusterInput()
meshes = ClusterInput()
meshes_2 = Mesh(meshes)
mjoin = MeshJoin(Meshes=meshes_2)
xline = ClusterInput()
yline = ClusterInput()
tool = PythonScript(meshes=mjoin, breps=breps, xline=xline, yline=yline)  # -> tool; inputs meshes: list of Mesh, breps: list of Brep
# ---------- tool: Python ----------
import Rhino.Geometry as rg
from compas_fab.fab.geometry import Frame
from compas_fab.fab.robots import Tool
from compas.datastructures.mesh import Mesh

xaxis = rg.Line(xline.PointAtStart, xline.PointAtEnd)
yaxis = rg.Line(yline.PointAtStart, yline.PointAtEnd)

if xaxis.From.DistanceTo(yaxis.From) < 0.01:
    origin = xaxis.From
    xaxis = xaxis.Direction
    yaxis = yaxis.Direction
elif xaxis.To.DistanceTo(yaxis.To) < 0.01:
    origin = xaxis.To
    xaxis = -xaxis.Direction
    yaxis = -yaxis.Direction
elif xaxis.From.DistanceTo(yaxis.To) < 0.01:
    origin = xaxis.From
    xaxis = xaxis.Direction
    yaxis = -yaxis.Direction
elif xaxis.To.DistanceTo(yaxis.From) < 0.01:
    origin = xaxis.To
    xaxis = -xaxis.Direction
    yaxis = yaxis.Direction

xaxis.Unitize()
yaxis.Unitize()

print origin
print xaxis
print yaxis

tcp_frame = Frame(origin, xaxis, yaxis)

tool = Tool(tcp_frame)
tool.model = meshes
tool.breps = breps
# ---------- end tool ----------
tool_2 = ClusterOutput(tool)
